# Grasshopper definition voxelize.gh (Grasshopper 0.9.76)
# plug-ins: Python Interpreter

mesh = Mesh(<mesh referenced from the Rhino model>)
mesh_2 = Mesh(mesh)

# ----
# Skeleton
panel = Panel("1.2")  # disabled
number_slider = Slider(0, range=0..20)  # disabled
num = Number(panel)  # disabled
mshadow = MeshShadow(Mesh=mesh_2, Light=Vector(0, 0, -1), Plane=PlaneXY(0, 0, 0))  # disabled
number_slider_2 = Slider(100, range=0..100)  # disabled
Z = UnitZ(Factor=number_slider)  # disabled
clean_holes = PythonScript(C=mshadow)  # -> C; inputs C: tree; disabled
# ---------- clean_holes: Python ----------
import rhinoscriptsyntax as rs
import math
import Rhino.Geometry as rg
from clr import AddReference as addr
addr("Grasshopper")
from System import Object
from Grasshopper import DataTree
from Grasshopper.Kernel.Data import GH_Path
import os

def dataTreeToList(aTree):
    theList = []
    for i in range(aTree.BranchCount ):
        thisListPart = []
        thisBranch = aTree.Branch(i)
        for j in range(len(thisBranch)):
            thisListPart.append( thisBranch[j] )
        theList.append(thisListPart)
    return theList

def raggedListToDataTree(raggedList):
    rl = raggedList
    result = DataTree[object]()
    for i in range(len(rl)):
        temp = []
        for j in range(len(rl[i])):
            temp.append(rl[i][j])
        #print i, " - ",temp
        path = GH_Path(i)
        result.AddRange(temp, path)
    return result

C = dataTreeToList(C)

C2 = []

for crvs in C:
    max_length = 0
    for crv in crvs:
        length = rs.CurveLength(crv)
        if length > max_length:
            max_length = length
            selected_crv = crv
    C2.append(selected_crv)

C = C2
# ---------- end clean_holes ----------
move = Move(Geometry=mshadow, Motion=Z)  # -> Geometry, Transform; disabled
divide = DivideCurve(Curve=clean_holes, Count=number_slider_2, Kinks=False)  # -> Points, Tangents, Parameters; disabled
skeleton_num = Slider(10, range=2..20)  # disabled
con = DelaunayEdges(Points=divide.Points, Plane=PlaneXY(0, 0, 0))  # -> Connectivity, Edges; disabled
_2d_skel = PythonScript(C=clean_holes, E=con.Edges, cut_param=num)  # -> S; inputs C: list, E: tree; disabled
# ---------- _2d_skel: Python ----------
import rhinoscriptsyntax as rs
import math
import Rhino.Geometry as rg
from clr import AddReference as addr
addr("Grasshopper")
from System import Object
from Grasshopper import DataTree
from Grasshopper.Kernel.Data import GH_Path
import os

def dataTreeToList(aTree):
    theList = []
    for i in range(aTree.BranchCount ):
        thisListPart = []
        thisBranch = aTree.Branch(i)
        for j in range(len(thisBranch)):
            thisListPart.append( thisBranch[j] )
        theList.append(thisListPart)
    return theList

def raggedListToDataTree(raggedList):
    rl = raggedList
    result = DataTree[object]()
    for i in range(len(rl)):
        temp = []
        for j in range(len(rl[i])):
            temp.append(rl[i][j])
        #print i, " - ",temp
        path = GH_Path(i)
        result.AddRange(temp, path)
    return result

def containment(pt, crv):
    cont = True
    far_away_point = rs.AddPoint(9999,9999,0)
    line = rs.AddLine(pt,far_away_point)
    X = rs.CurveCurveIntersection(line,crv)
    if X==None or len(X)%2==0: cont = False
    return cont

E = dataTreeToList(E)

S = []

for edges,contour in zip(E,C):
    pts = []
    for edge in edges:
        mid = rs.CurveMidPoint(edge)
        ## take away points on edge
        t = rs.CurveClosestPoint(contour,mid)
        cp = rs.EvaluateCurve(contour,t)
        dist = rs.Distance(mid,cp)
        if dist<cut_param: continue
        ## take away points outside contour
        if containment(mid,contour)==False: continue
        pts.append(mid)
    S.append(pts)

# simplyfy point list


d = 2
S2 = []
for pts in S:
    new_pts = []
    for pt in pts:
        min_dist = 9999
        for pt2 in new_pts:
            dist = rs.Distance(pt,pt2)
            if dist<min_dist:
                min_dist = dist
        if min_dist>d:
            new_pts.append(pt)
    S2.append(new_pts)

S = raggedListToDataTree(S2)
# ---------- end _2d_skel ----------
sort = PythonScript(P=_2d_skel)  # -> P; inputs P: list of Point3d; disabled
# ---------- sort: Python ----------
import rhinoscriptsyntax as rs

def get_average_point(pts):
    x = 0
    y = 0
    z = 0
    for pt in pts:
        x = x+pt[0]
        y = y+pt[1]
        z = z+pt[2]
    x = x/len(pts)
    y = y/len(pts)
    z = z/len(pts)
    pt = rs.AddPoint(x,y,z)
    return pt

def get_closest_point(pts,pt2):
    mindist = 9999
    sel_index = None
    for i in range(len(pts)):
        dist = rs.Distance(pts[i],pt2)
        if dist<mindist:
            mindist = dist
            sel_index = i
    if sel_index!=None:
        sel_pt = pts[sel_index]
        pts.pop(sel_index)
    else:
        sel_pt = None
    return pts,sel_pt


P2 = []

st = P[0]
en = P[-1]

# find midpoint by closest point to average point
mid = get_average_point(P)
P,mid = get_closest_point(P,mid)
if mid!=None: P2.append(mid)
P,next = get_closest_point(P,mid)
if next!=None: P2.append(next)
dist = rs.Distance(mid,next)



# find next closest point interatively
for i in range(len(P)):
    P,next2 = get_closest_point(P,next)
    if rs.Distance(next,next2)>5*dist or next2==None: break
    P2.append(next2)
    next = next2

P2.reverse()

# and in other direction
P,next = get_closest_point(P,mid)
if next!=None: P2.append(next)
for i in range(len(P)):
    P,next2 = get_closest_point(P,next)
    if rs.Distance(next,next2)>5*dist or next2==None: break
    P2.append(next2)
    next = next2


# correct directopm
dist1 = rs.Distance(P2[0],st)
dist2 = rs.Distance(P2[-1],st)
if dist2<dist1:
    P2.reverse()

P = P2
# ---------- end sort ----------
nurbs = NurbsCurve(Vertices=sort, Degree=3, Periodic=False)  # -> flatten(Curve), Length, Domain; disabled
number_slider_3 = Slider(0.28, range=0..1)  # disabled
number_slider_4 = Slider(-3, range=-4..2)  # disabled
edges = PythonScript(C=clean_holes, S=nurbs.Curve)  # -> S; disabled
# ---------- edges: Python ----------
import rhinoscriptsyntax as rs

rs.ExtendCurve(S,2,0,[C])
rs.ExtendCurve(S,2,1,[C])

rs.ExtendCurveLength(S,0,0,-1)
rs.ExtendCurveLength(S,2,1,-1)
# ---------- end edges ----------
corr_skeleton = PythonScript(skel_2d=edges, mesh=mesh_2, ext=number_slider_4)  # -> skel_3d, skel_pts, radii, aver_r; disabled
# ---------- corr_skeleton: Python ----------
import rhinoscriptsyntax as rs
import Rhino.Geometry as rg

def projectPointToMesh(pt,mesh):
    pt1 = None
    ptX = rs.ProjectPointToMesh(pt,mesh,(0,0,1))
    if ptX!=None and len(ptX)==1: 
        pt1 = ptX[0]
    elif ptX!=None and len(ptX)>1:
        pts_list = []
        for x in ptX: pts_list.append(x)
        pts_list.sort(key=getZ)
        pt1 = pts_list[-1]
    else:
        print "error - no point projection found"
    return pt1

def averagePoint(p1,p2):
    x = 0.5*p1[0]+0.5*p2[0]
    y = 0.5*p1[1]+0.5*p2[1]
    z = 0.5*p1[2]+0.5*p2[2]
    p = rs.AddPoint(x,y,z)
    return p


def getZ(point):
    return point[2]

def polyline_to_curve(pl):
    crv = rg.Polyline.ToNurbsCurve(pl)
    return crv


###

crv = skel_2d

### variables inside

step = 4
lower_z_limit = 1.5


###
skel_pts = []
radii = []


a = []

###
length = rs.CurveLength(crv)
n = int(0.5+length/step)
rs.ExtendCurveLength(crv,0,0,ext)
rs.ExtendCurveLength(crv,0,1,ext)
pts = rs.DivideCurve(crv,n)
new_pts = []
for pt in pts:
    t = rs.CurveClosestPoint(crv,pt)
    tan = rs.CurveTangent(crv,t)
    tan = rs.VectorUnitize(tan)
    pt_up = projectPointToMesh(pt,mesh)
    r = None
    if pt_up!=None:
        p_start = rs.AddPoint(pt[0],pt[1],lower_z_limit)
        p_end = rs.AddPoint(pt_up[0],pt_up[1],pt_up[2]-lower_z_limit)
        line = rs.AddLine(p_start,p_end)
        n = int(rs.Distance(p_start,p_end)/0.2)+1
        zpts = rs.DivideCurve(line,n)
        if zpts!=None and len(zpts)>0:
            R = []
            P = []
            for zpt in zpts:
                pln = rs.PlaneFromNormal(zpt,(0,0,1),tan)
                rect = rs.AddRectangle(pln,2,10)
                rs.MoveObject(rect,-1*tan)
                rect2 = rs.CopyObject(rect,-10*pln.YAxis)
                param = rg.MeshingParameters()
                rect = rg.Mesh.CreateFromPlanarBoundary(rs.coercecurve(rect),param)
                rect2 = rg.Mesh.CreateFromPlanarBoundary(rs.coercecurve(rect2),param)
                crv1 = rs.MeshMeshIntersection(mesh,rect)
                crv2 = rs.MeshMeshIntersection(mesh,rect2)
                if crv1!=None and crv2!=None:
                    crv1 = polyline_to_curve(crv1[0])
                    crv2 = polyline_to_curve(crv2[0])
                    t = rs.CurveClosestPoint(crv1,zpt)
                    pt1 = rs.EvaluateCurve(crv1,t)
                    t = rs.CurveClosestPoint(crv2,zpt)
                    pt2 = rs.EvaluateCurve(crv2,t)
                    r = 0.5*rs.Distance(pt1,pt2)
                    R.append(r)
                    new_pt = rs.CurveMidPoint(rs.AddLine(pt1,pt2))
                    P.append(new_pt)
            R = sorted(R)
            P = [x for _,x in sorted(zip(R,P))]
            if len(R)>0: r = R[-1]
            else: r = 2.2
            if len(P)>0: pt = P[-1]
            else: pt =zpt
        else:
            print "error with zpts"
            a.append(line)
    new_pts.append(pt)
    radii.append(r)

r_sum = 0
count = 0
for r in radii:
    if r!=None:
        r_sum = r_sum+r
        count = count+1
average_r = r_sum/count

for i in range(len(radii)):
    if radii[i] == None:
        radii[i] = average_r

for i in range(len(new_pts)):
    pt = new_pts[i]
    pt_up = projectPointToMesh(pt,mesh)
    if pt_up!=None:
        zpt = rs.AddPoint(0,0,-radii[i])
        pt = rs.PointAdd(zpt,pt_up)
        new_pts[i] = pt

### extend
crv = rs.AddCurve(new_pts)
crv = rs.ExtendCurveLength(crv,0,0,-ext)
crv = rs.ExtendCurveLength(crv,0,1,-ext)
st = rs.CurveStartPoint(crv)
en = rs.CurveEndPoint(crv)
new_pts.append(en)
new_pts.insert(0,st)
radii.append(radii[-1])
radii.insert(0,radii[0])



###
skel_3d = rs.AddCurve(new_pts,3)

skel_pts = new_pts

aver_r = average_r
# ---------- end corr_skeleton ----------
lng = ListLength(List=corr_skeleton.skel_pts)  # disabled
multiplication = Multiplication(A=lng, B=number_slider_3)  # disabled
num_2 = Number(skeleton_num)  # disabled
int = Integer(multiplication)  # disabled
item = ListItem(List=corr_skeleton.skel_pts, Index=int, Wrap=True)  # -> Item, Item1, Item2, Item3; disabled

mshadow_2 = MeshShadow(Mesh=mesh_2, Light=Vector(0, 0, -1), Plane=PlaneXY(0, 0, 0))  # disabled
preview = CustomPreview(Geometry=mesh_2, Shader=ColourSwatch(SwatchColor=RGBA(255, 0, 0, 46)))

# ----
# Tangent vector
X = UnitX(Factor=1)  # disabled
vec2pt = Vector2Pt(PointA=item.Item, PointB=item.Item1, Unitize=False)  # -> Vector, Length; disabled
angle = Angle(VectorA=X, VectorB=vec2pt.Vector)  # -> Angle, Reflex; disabled
vdis = VectorDisplay(Anchor=item.Item, Vector=vec2pt.Vector)  # disabled

pt = Point(Point(138, -14, 0))  # disabled
number_slider_5 = Slider(3.7, range=0..10)  # disabled
number_slider_6 = Slider(20, range=4..64)  # disabled
pt_2 = Point(item.Item)  # disabled
xy = XYPlane(Origin=pt)  # disabled
_3d_grid = GhPythonScript(pln=xy, d=number_slider_5, n=number_slider_6)  # -> out, P; disabled
# ---------- _3d_grid: Python ----------
__author__ = "hyoshida"
__version__ = "2020.06.04"

import rhinoscriptsyntax as rs

n=int(n)
P=[]

for i in range(n):
    for j in range(n):
        for k in range(n):
            x =i*pln.XAxis*d
            y =j*pln.YAxis*d
            z =k*pln.ZAxis*d
            pt = pln.Origin+x+y+z
            P.append(pt)
# ---------- end _3d_grid ----------
box = CenterBox(Base=xy, X=1, Y=1, Z=1)  # disabled

# ----
# Rotate the box
pt_3 = Point(Point(10.07435832, 3.327362213, -9.103156538))
number_slider_7 = Slider(1.5, range=-1.5..1.5)
xy_2 = XYPlane(Origin=pt_3)
vec = VectorXYZ(XComponent=Slider(0.2, range=-1..1), YComponent=Slider(0, range=0..1), ZComponent=Slider(0, range=0..1))  # -> Vector, Length
rot3d = Rotate3D(Geometry=xy_2, Angle=number_slider_7, Center=xy_2, Axis=vec.Vector)  # -> Geometry, Transform

slider_index = Number(number_slider_7)
toggle = BooleanToggle(False)
panel_2 = Panel("Right")

# ----
# Export
path = Panel("C:\Users\makal\git\grain\data")  # disabled
button = Button()  # disabled
export_to_csv = PythonScript(path=path, export=button)  # inputs true_false_pattern: tree; disabled
# ---------- export_to_csv: Python ----------
import rhinoscriptsyntax as rs
import ghpythonlib.treehelpers as th
import os

TF = th.tree_to_list(true_false_pattern)

if export:
    # filename
    files = os.listdir(path)
    if len(files)>0:
        last_name = files[-1].split('.')[0]
        last_num = last_name.split('_')[-1]
        num = int(last_num)+1
    else: num=1
    filename = 'voxel_data_'+str(num).zfill(3)+'.txt'
    file = open(path+'\\'+filename, 'w')
    # add data to lines
    txtdata = ''
    for i in range(len(TF)):
        for j in range(len(TF[i])):
            for k in range(len(TF[i][j])):
                if TF[i][j][k]: txtdata += '0,'
                else: txtdata += '1,'
            txtdata += ':'
        txtdata += '\n'
    file.write(txtdata)
    file.close()
    print("Exported "+filename)
# ---------- end export_to_csv ----------

box_size = Slider(0.9, range=0..10)
resolution = Slider(32, range=4..64)
box_2 = CenterBox(Base=rot3d.Geometry, X=box_size, Y=box_size, Z=box_size)
_3d_grid_2 = GhPythonScript(pln=rot3d.Geometry, edge_len=box_size, res=resolution, export=toggle)  # -> P, center_shift, edge_len
# ---------- _3d_grid_2: Python ----------
__author__ = "hyoshida"
__version__ = "2020.06.04"

import rhinoscriptsyntax as rs
from Rhino.Geometry import Point3d


if export == False:
    n = 10
else:
    n=int(res)
    
print export, n

P=[]
print(pln.Origin)
d = edge_len *2 / n

edge_len = (n-1)*d
#print(edge_len)
center_shift = Point3d(-edge_len/2, -edge_len/2, -edge_len/2)
print center_shift
#center_shift = rs.CreatePoint(-edge_len/2, -edge_len/2, -edge_len/2)
print(center_shift)
for i in range(int(-n/2), int(n/2)):
    for j in range(int(-n/2), int(n/2)):
        for k in range(int(-n/2), int(n/2)):
            x =i*pln.XAxis*d
            y =j*pln.YAxis*d
            z =k*pln.ZAxis*d
            pt = pln.Origin+x+y+z #+ center_shift  #- rs.CreatePoint(-10,-10,-10)
            P.append(pt)

#edge_len /= 2
# ---------- end _3d_grid_2 ----------
swatch = ColourSwatch(SwatchColor=RGBA(255, 0, 0, 23))  # disabled
medges = MeshEdges(Mesh=box_2)  # -> NakedEdges, InteriorEdges, NonManifoldEdges
preview_2 = CustomPreview(Geometry=box_2, Shader=swatch)  # disabled

mint = MeshIntersection(MeshesA=mesh_2, MeshesB=box_2)
preview_3 = CustomPreview(Geometry=mint, Shader=ColourSwatch(SwatchColor=RGBA(0, 0, 255, 23)))

pattern_1 = MeshInclusion(Mesh=mint, Point=_3d_grid_2.P, Strict=False)
cull = CullPattern(List=_3d_grid_2.P, CullPattern=pattern_1)

# ----
# Rotate the mask box
y = Slider(1, range=0..1)
z = Slider(0.6, range=0..1)
x = Slider(0.8, range=0..1)
Z_2 = UnitZ(Factor=1)
multiplication_2 = Multiplication(A=box_size, B=y)
multiplication_3 = Multiplication(A=box_size, B=z)
multiplication_4 = Multiplication(A=box_size, B=x)
box_3 = CenterBox(Base=xy_2, X=multiplication_4, Y=multiplication_2, Z=multiplication_3)
rot3d_2 = Rotate3D(Geometry=box_3, Angle=number_slider_7, Center=xy_2, Axis=vec.Vector)  # -> Geometry, Transform
medges_2 = MeshEdges(Mesh=rot3d_2.Geometry)  # -> NakedEdges, InteriorEdges, NonManifoldEdges
preview_4 = CustomPreview(Geometry=rot3d_2.Geometry, Shader=ColourSwatch(SwatchColor=RGBA(0, 0, 255, 29)))
pattern_2 = MeshInclusion(Mesh=rot3d_2.Geometry, Point=cull, Strict=False)
cull_2 = CullPattern(List=cull, CullPattern=pattern_2)
masked = CustomPreview(Geometry=cull_2, Shader=ColourSwatch(SwatchColor=RGB(0, 0, 255)))

pln = Plane(Z_2)

# ----
# Mask sphere
number_slider_8 = Slider(0.8, range=0..1)

multiplication_5 = Multiplication(A=box_size, B=number_slider_8)

msphere = MeshSphere(Base=xy_2, Radius=multiplication_5, UCount=10, VCount=20)
pattern2 = MeshInclusion(Mesh=msphere, Point=cull, Strict=False)
cull_3 = CullPattern(List=cull, CullPattern=pattern2)
masked_2 = CustomPreview(Geometry=cull_3, Shader=ColourSwatch(SwatchColor=RGB(0, 0, 255)))

# ----
# 1. make the toggle false
# 2. clear the Rec
# 3. change name
# 4.animate slider
button_2 = Button()  # disabled
dir = Panel("C:\Users\hiron\git\3Dshape_completion\gh_exported")
name = Panel("tree63")
rec = DataRecorder(slider_index, DataLimit=-10, RecordData=True)
panel_3 = Panel([multiplication_4, multiplication_2, multiplication_3])
panel_4 = Panel(box_size)
panel_5 = Panel(rot3d.Geometry)
lng_2 = ListLength(List=flatten(rec))  # -> expr("Max(0, (x-1)\2)", Length)
panel_6 = Panel(lng_2)
time = Time("Now")
panel_7 = Panel(time)
python = PythonScript(
    time=panel_7,
    dir=dir,
    name=name,
    index=lng_2,
    res=resolution,
    box_pos=panel_5,
    box_size=panel_4,
    mask_box=panel_3,
    sphere=multiplication_5,
    export=toggle)  # -> out, a; inputs time: list, box_size: list, mask_box: list
# ---------- python: Python ----------
import os, sys

print str(int(res))

dir = dir + "/" + name + "/"
if os.path.exists(dir) is False:
    print dir + " does not exist"
    os.mkdir(dir)

print(dir)
print(index)
path = dir+name + "_" + index +   "_" + str(int(res))+ "_info.txt"
print(path)

if export:
    path = dir+name + "_" + index + "_" + str(int(res))+ "_info.txt"
    file = open(path, 'w')
    file.writelines("box_pos, "+ box_pos[0] + '\n')
    file.writelines("box_vec, "+ box_pos[1] + '\n')
    file.writelines("box_size,"+ box_size[0] + '\n')
    file.writelines("box_res,"+ str(res) + '\n')
    file.writelines("mask_box_x, "+ mask_box[0] + '\n')
    file.writelines("mask_box_y, " + mask_box[1] + '\n')
    file.writelines("mask_box_z, " + mask_box[2] + '\n')
    file.writelines("sphere, "+ str(sphere) + '\n')
    file.close()
# ---------- end python ----------
python_2 = GhPythonScript(pattern_1=pattern_1, pattern_2=pattern2, name=name, index=lng_2, size=resolution, dir=dir, export=toggle)  # inputs pattern_1: list, pattern_2: list
# ---------- python_2: Python ----------
__author__ = "hyoshida"
__version__ = "2020.06.04"

import rhinoscriptsyntax as rs
import os, sys

#import sys, os
#import Grasshopper as gh
#sys.path.append(os.path.realpath('..'))
#print sys.path
##dirname = os.path.dirname(__file__)
##import os
#print os.path.abspath(os.getcwd())
dir = dir + "/" + name + "/"
if os.path.exists(dir) is False:
    print dir + " does not exist"
    os.mkdir(dir)

print(name, size)


path_common = dir+name  + "_" + index + "_" + str(int(size))
print(path_common)

if export:
    path = path_common + "_pattern_1.txt"
    file = open(path, 'w')
    file.writelines(str(int(size)) + '\n')
    for n, i in enumerate(pattern_1):
        if(i == True): 
            file.writelines(str(1))
        else: file.writelines(str(0))
        if(n is not len(pattern_1)-1): file.writelines(",")
    file.close()

    path_missing = path_common + "_pattern_2.txt"
    file = open(path_missing, 'w')
    file.writelines(str(int(size)) + '\n')
    for n, i in enumerate(pattern_2):
        if(i == True): 
            file.writelines(str(1))
        else: file.writelines(str(0))
        if(n is not len(pattern_1)-1): file.writelines(",")
    file.close()
# ---------- end python_2 ----------

python_3 = GhPythonScript(pattern_1=pattern_1, pattern_2=pattern_2, name=name, size=resolution, dir=dir)  # -> masked_vol, missing_parts; inputs pattern_1: list, pattern_2: list; disabled
# ---------- python_3: Python ----------
__author__ = "hyoshida"
__version__ = "2020.06.04"

import rhinoscriptsyntax as rs

#import sys, os
#import Grasshopper as gh
#sys.path.append(os.path.realpath('..'))
#print sys.path
##dirname = os.path.dirname(__file__)
##import os
#print os.path.abspath(os.getcwd())


print(name, size)

slider_index = str(slider_index)
print slider_index

if export:
    path = dir+name + "_" + slider_index + "_" + str(int(size))+"_whole.txt"
    file = open(path, 'w')
    file.writelines(str(int(size)) + '\n')
    for n, i in enumerate(pattern_1):
        if(i == True): 
            file.writelines(str(1))
        else: file.writelines(str(0))
        if(n is not len(pattern_1)-1): file.writelines(",")
    file.close()

culled_idx = 0
culled_list = []

for n, i in enumerate(pattern_1):
    if(i == True): 
        culled_list.append(n)

#print(culled_list)
#print(pattern_2)

culled_list_index = 0
masked_vol = pattern_1
missing_parts = [False]*len(pattern_1)

print len(masked_vol), len(missing_parts)

for i, vox in enumerate(masked_vol):
    if any(i == c for c in culled_list):
        if(pattern_2[culled_list_index] == True):
#            print("missing parts" , i, "masked vol", masked_vol[i])
            missing_parts[i] = True
            masked_vol[i] = False
        culled_list_index +=1


if export:
    ### writing missing parts
    path_missing = dir+name + "_" + slider_index + "_" +str(int(size))+"_missing.txt"
    file = open(path_missing, 'w')
    file.writelines(str(int(size)) + '\n')
    for n, vox in enumerate(missing_parts):
        if(i == True): 
            file.writelines(str(1))
        else: file.writelines(str(0))
        if(n is not len(pattern_1)-1): file.writelines(",")
    file.close()
    
    ### writing masked parts
    path_masked = dir+name + "_" + slider_index + "_" +str(int(size))+"_masked.txt"
    file = open(path_masked, 'w')
    file.writelines(str(int(size)) + '\n')
    for n, vox in enumerate(masked_vol):
        if(i == True): 
            file.writelines(str(1))
        else: file.writelines(str(0))
        if(n is not len(pattern_1)-1): file.writelines(",")
    file.close()
# ---------- end python_3 ----------
cull_4 = CullPattern(List=_3d_grid_2.P, CullPattern=python_3.masked_vol)  # disabled
cull_5 = CullPattern(List=_3d_grid_2.P, CullPattern=python_3.missing_parts)  # disabled
swatch_2 = ColourSwatch(SwatchColor=RGB(255, 0, 0))  # disabled
swatch_3 = ColourSwatch(SwatchColor=RGB(8, 0, 255))  # disabled
masked_3 = CustomPreview(Geometry=cull_4, Shader=swatch_2)  # disabled
missing = CustomPreview(Geometry=cull_5, Shader=swatch_3)  # disabled

rec_2 = DataRecorder(button_2, DataLimit=-10, RecordData=True)  # disabled
lng_3 = ListLength(List=flatten(rec_2))  # -> expr("Max(0, (x-1)\2)", Length); disabled
python_4 = PythonScript(name=name, dir=dir)  # -> out, Dir
# ---------- python_4: Python ----------
print dir , name
Dir = dir + "/" + name
# ---------- end python_4 ----------
python_5 = PythonScript(name=name, index=lng_2)  # -> out, name
# ---------- python_5: Python ----------
print name , index
name = name + "_" + index + ".png"
# ---------- end python_5 ----------

panel_8 = Panel("_{0}.png")
panel_9 = Panel(python_5.name)
c_script = CSharpScript(Dir=python_4.Dir, Name=panel_9, VP="Perspective", Capture=toggle, Trigger=Slider(0, range=0..1))  # -> out, A; inputs Dir: String, Name: String, VP: String, Capture: Boolean
# ---------- c_script: C# ----------
    if (!Capture) return;
    if (string.IsNullOrWhiteSpace(Dir)) return;
    if (string.IsNullOrWhiteSpace(Name)) return;

    // Make sure the directory ends with a \
    if (!Dir.EndsWith(System.IO.Path.DirectorySeparatorChar.ToString()))
      Dir += System.IO.Path.DirectorySeparatorChar;

    // Do not create directories, only use existing ones.
    if (!System.IO.Directory.Exists(Dir))
      return;

    // Assume index=0 for the first filename.
    string fileName = Dir + string.Format(Name, 0);

    // Try to increment the index until we find a name which doesn't exist yet.
    if (System.IO.File.Exists(fileName))
      for (int i = 1; i < int.MaxValue; i++)
      {
        string localName = Dir + string.Format(Name, i);
        if (localName == fileName)
          return;

        if (!System.IO.File.Exists(localName))
        {
          fileName = localName;
          break;
        }
      }


    Rhino.Display.RhinoView view = RhinoDocument.Views.Find(VP, false);
    Bitmap image = view.CaptureToBitmap(true, false, false);
    A = image.Width;
    image.Save(fileName);
    image.Dispose();

    A = fileName;
# ---------- c_script: C# additional code ----------
  //Return a BoundingBox that contains all the geometry you are about to draw.
  public override BoundingBox ClippingBox
  {
    get
    {
      return BoundingBox.Empty;
    }
  }

  //Draw all meshes in this method.
  public override void DrawViewportMeshes(IGH_PreviewArgs args)
  {
  }

  //Draw all wires and points in this method.
  public override void DrawViewportWires(IGH_PreviewArgs args)
  {
  }
# ---------- end c_script ----------

panel_10 = Panel(python_4.Dir)
